# Grasshopper definition safeNet_GHdefinitions.gh (Grasshopper 1.0.8)
# plug-ins: RhinoCodePluginGH, DeCodingSpaces

# ---- group: Create dataframe (from scratch) v001
py3 = Python3Script()  # -> dataframe; inputs columns: list, data: tree
# ---------- py3: Python ----------
import pandas as pd

def tree_to_dataframe(columns, data_tree):
    # Ensure the number of branches matches the number of columns
    if len(columns) != len(data_tree.Branches):
        raise ValueError("The number of columns must match the number of branches in the data tree")
    
    # Convert each branch in the data tree to a column
    data_dict = {col: data_tree.Branches[i] for i, col in enumerate(columns)}
    
    # Create DataFrame
    df = pd.DataFrame(data_dict)
    return df

# Inputs
column_list = columns  # List of column names
data_tree = data  # Data should be a tree joined with entwined

# Convert the data tree to a DataFrame
df = tree_to_dataframe(columns, data_tree)

# Output
dataframe = df  # Output the DataFrame
# ---------- end py3 ----------

# ---- group: CSV to Dataframe
# DATAFRAMES
py3_2 = Python3Script()  # -> dataFrame
# ---------- py3_2: Python ----------
#! python3
#r: openpyxl, psycopg2, Ipython

#THIS IS NECESSARY TO LOAD PANDAS otherwise it bugs
import locale
locale.setlocale(locale.LC_ALL, 'en_US')

import pandas as pd
import matplotlib as plt
import geopandas as gpd

#############################################################

dataFrame = pd.read_csv(CSV)
# ---------- end py3_2 ----------

# ---- group: Dataframe Details
py3_3 = Python3Script(dataFrame=py3_2)  # -> info, column_name, head_x10, tail_x10, shape, number_of_null_values
# ---------- py3_3: Python ----------
info = dataFrame.info

head_x10 = dataFrame.head(10)
tail_x10 = dataFrame.tail(10)
shape = dataFrame.shape

#Add up all null values
number_of_null_values = dataFrame.isnull().sum()



# columns = dataFrame.columns
# Get the columns as a list
column_name = dataFrame.columns.tolist()

# Output the list
# print(column_name)
# ---------- end py3_3 ----------

# ---- group: SHP to GeoDataframe
py3_4 = Python3Script()  # -> GeoDataFrame
# ---------- py3_4: Python ----------
#! python3
#r: openpyxl, psycopg2, Ipython

#THIS IS NECESSARY TO LOAD PANDAS otherwise it bugs
import locale
locale.setlocale(locale.LC_ALL, 'en_US')

import geopandas as gpd

GeoDataFrame = gpd.read_file(SHP)
# ---------- end py3_4 ----------

# ---- group: CSV to SHP
py3_5 = Python3Script()  # -> GeoDataFrame, shp_file
# ---------- py3_5: Python ----------
import pandas as pd
import geopandas as gpd
from shapely.geometry import Point

# Read CSV file
df = pd.read_csv(csv_file)


# Make sure CSV file has columns for latitud and longitud
# if 'latitude' not in df.columns or 'longitude' not in df.columns:
    # raise ValueError("CSV file must have 'latitude' and 'longitude' columns")
    

# Create point geometry based on coordinates
geometry = [Point(xy) for xy in zip(df[longitude_column_name], df[latitude_column_name])]
gdf = gpd.GeoDataFrame(df, geometry=geometry)

# Establish reference system (CRS), WGS84 for example
gdf.set_crs(epsg=4326, inplace=True)

# Display dataframe
GeoDataFrame = gdf

# Save as Shapefile
gdf.to_file(shp_file)

# print(GeoDataFrame.crs)
# ---------- end py3_5 ----------

# ---- group: dataframe to SHP
py3_6 = Python3Script(dataFrame=py3_2)  # -> GeoDataFrame, shp_file
# ---------- py3_6: Python ----------
import pandas as pd
import geopandas as gpd
from shapely.geometry import Point

# Read CSV file
df = dataFrame


# Make sure CSV file has columns for latitud and longitud
# if 'latitude' not in df.columns or 'longitude' not in df.columns:
    # raise ValueError("CSV file must have 'latitude' and 'longitude' columns")
    

# Create point geometry based on coordinates
geometry = [Point(xy) for xy in zip(df[longitude_column_name], df[latitude_column_name])]
gdf = gpd.GeoDataFrame(df, geometry=geometry)

# Establish reference system (CRS), WGS84 for example
gdf.set_crs(epsg=4326, inplace=True)

# Display dataframe
GeoDataFrame = gdf

# Save as Shapefile
gdf.to_file(shp_file)

# print(GeoDataFrame.crs)
# ---------- end py3_6 ----------

# ---- group: Save dataframe to csv file v001
py3_7 = Python3Script(df=py3)
# ---------- py3_7: Python ----------
import pandas as pd
import Grasshopper
import ghpythonlib.components as ghcomp

def save_dataframe_to_csv(df, file_path):
    # Save DataFrame to CSV
    df.to_csv(file_path, index=False)  # index=False avoids writing row numbers
    return "File saved successfully"

# Inputs
# df = x  # The DataFrame to be saved
# file_path = y  # The path where the CSV will be saved
# button = z  # The button state

# Check if button is pressed
if save_button:
    message = save_dataframe_to_csv(df, file_path)
# else:
#     message = "Press the button to save the file"

# # Output
# a = message  # Output a success message or status
# ---------- end py3_7 ----------

# ---- group: Remove Specific Rows
py3_8 = Python3Script(dataFrame=py3_2)  # -> filtered_DF
# ---------- py3_8: Python ----------
#Keep rows with specific info or filtering

data_to_filter = dataFrame[columnName] != value
filtered_DF = dataFrame[data_to_filter]
# ---------- end py3_8 ----------

# ---- group: Keep Specific Rows
py3_9 = Python3Script(dataFrame=py3_2)  # -> filtered_DF
# ---------- py3_9: Python ----------
#Keep rows with specific info or filtering

data_to_filter = dataFrame[columnName] == value
filtered_DF = dataFrame[data_to_filter]
# ---------- end py3_9 ----------

# ---- group: Remove Null Values
py3_10 = Python3Script(dataFrame=py3_2)  # -> clean_DF
# ---------- py3_10: Python ----------
#Remove null values
clean_DF = dataFrame.dropna()
# ---------- end py3_10 ----------

# ---- group: GeodataFrame projection
py3_11 = Python3Script(GeoDataFrame=py3_4)  # -> projection
# ---------- py3_11: Python ----------
projection = GeoDataFrame.crs
# ---------- end py3_11 ----------

# ---- group: Dataframe Head & Tail
py3_12 = Python3Script(dataFrame=py3_2)  # -> DF_head, DF_tail
# ---------- py3_12: Python ----------
num_of_rows = int(rows)
print(num_of_rows)
DF_head = dataFrame.head(num_of_rows)

num_of_rows = int(rows)
print(num_of_rows)
DF_tail = dataFrame.tail(num_of_rows)
# ---------- end py3_12 ----------

# ---- group: merge data frames v001
py3_13 = Python3Script()  # -> merged_df; inputs df_list: list
# ---------- py3_13: Python ----------
#! python3
#r: openpyxl, psycopg2, Ipython

#THIS IS NECESSARY TO LOAD PANDAS otherwise it bugs
import locale
locale.setlocale(locale.LC_ALL, 'en_US')

############ NOTES ####################################################
## Works but intput has to be list so data from merge component has to be flattened. 
## Output should be data tree instead

import pandas as pd

# Initialize with the first DataFrame
combined_df = df_list[0]

# Join each subsequent DataFrame
for df in df_list[1:]:
    combined_df = combined_df.join(df, how='outer')  # or use 'inner' if you want only matching keys

# Result DataFrame
merged_df = combined_df
# ---------- end py3_13 ----------

# ---- group: Create New Column
py3_14 = Python3Script(dataFrame=py3_2)  # -> out, dataFrame
# ---------- py3_14: Python ----------
dataFrame[new_column_name] = values
dataFrame
# ---------- end py3_14 ----------

# ---- group: Rename Columns
py3_15 = Python3Script(dataFrame=py3_2)  # -> dataFrame
# ---------- py3_15: Python ----------
#Rename columns
dataFrame.rename(columns={
        existing_column_name: new_column_name,
    }, inplace=True)
# ---------- end py3_15 ----------

# ---- group: Create dataframe (from scratch) v001
py3_16 = Python3Script()  # -> dataframe; inputs columns: list, data: tree; same code as py3

# ---- group: Column Values
py3_17 = Python3Script(dataFrame=py3_2)  # -> columnValues
# ---------- py3_17: Python ----------
columnValues = dataFrame[column_name].tolist()
# ---------- end py3_17 ----------

# ---- group: Remove Column
py3_18 = Python3Script(dataFrame=py3_2)  # -> dataFrame
# ---------- py3_18: Python ----------
## This works but leaves a none type witin the column
# dataFrame = dataFrame.drop([column_name], axis = 1)

#This deletes completely
del dataFrame[column_name]
# ---------- end py3_18 ----------

# ----
crv = Curve([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])
network2segments = NetworkToSegments(NetworkGeometry=crv, ConvertCurves=True, ConversionAngle=0.2, Split=True)
line = Line(network2segments)

dom = ConstructDomain(DomainStart=Slider(0, range=0..2), DomainEnd=Slider(3, range=0..3))
random = Random(Range=dom, Number="4", Seed=2)
round = Round(Number=random)  # -> Nearest, Floor, Ceiling

dom_2 = ConstructDomain(DomainStart=Slider(0, range=0..2), DomainEnd=Slider(2, range=0..3))
random_2 = Random(Range=dom_2, Number="46", Seed=2)
round_2 = Round(Number=random_2)  # -> Nearest, Floor, Ceiling

# ---- group: Put together edge dataframes WORKING
panel = Panel("""8
10
12
8""")
panel_2 = Panel("""broadway
hope
figueroa
cesar chavez""")
panel_3 = Panel("""100
300
150
200""")
panel_4 = Panel("""high
low
high
medium""")
entwine = Entwine(Branch00=panel_2, Branch01=panel_4, Branch02=panel_3, Branch03=panel, FlattenInputs=True)

# ----
panel_5 = Panel("""name_norm
age_norm
city_norm
date_norm""")
merge = Merge(Data1=panel_5)  # -> flatten(Result)
panel_6 = Panel("""street
traffic
length
width""")

# ---- group: Inverse node network v002
py3_19 = Python3Script(lines=line)  # -> inv_points, inv_lines; inputs lines: list of Line
#   port lines: List of connected lines that represent a network
#   port inv_points: Points resulting from the intersections and connections of new network
#   port inv_lines: Inverted connections creating an inverse network
# ---------- py3_19: Python ----------
#! python3
#r: openpyxl, psycopg2, Ipython

import Rhino.Geometry as rg

# Inputs: 
# lines: A list of lines representing streets (input from Grasshopper)

network = lines

def invert_graph(network):
    # Step 1: Calculate midpoints
    midpoints = [line.PointAt(0.5) for line in network]
    
    # Step 2: Determine connections between streets (by checking shared endpoints)
    connections = []
    for i, line1 in enumerate(network):
        for j, line2 in enumerate(network):
            if i >= j:
                continue  # Avoid duplicate pairs and self-comparison
            
            # Check if the lines share an endpoint
            if line1.From == line2.From or line1.From == line2.To or \
               line1.To == line2.From or line1.To == line2.To:
                # Create a line between the midpoints of connected streets
                connections.append(rg.Line(midpoints[i], midpoints[j]))

    return midpoints, connections

# Call the function with your input list of lines
midpoints, connections = invert_graph(lines)

# Outputs for the Grasshopper component
inv_points = midpoints       # List of points (midpoints)
inv_lines = connections     # List of lines (connections between midpoints)
print(inv_points)
print(inv_lines)
# ---------- end py3_19 ----------

# ---- group: edge classes / Create dataframe (from scratch) v001
py3_20 = Python3Script(columns="classes", data=round.Nearest)  # -> dataframe; inputs columns: list, data: tree
# ---------- py3_20: Python ----------
#! python3
#r: openpyxl, psycopg2, Ipython

import pandas as pd

def tree_to_dataframe(columns, data_tree):
    # Ensure the number of branches matches the number of columns
    if len(columns) != len(data_tree.Branches):
        raise ValueError("The number of columns must match the number of branches in the data tree")
    
    # Convert each branch in the data tree to a column
    data_dict = {col: data_tree.Branches[i] for i, col in enumerate(columns)}
    
    # Create DataFrame
    df = pd.DataFrame(data_dict)
    return df

# Inputs
column_list = columns  # List of column names
data_tree = data  # Data should be a tree joined with entwined

# Convert the data tree to a DataFrame
df = tree_to_dataframe(columns, data_tree)

# Output
dataframe = df  # Output the DataFrame
# ---------- end py3_20 ----------

# ---- group: edge features / Create dataframe (from scratch) v001
py3_21 = Python3Script(columns=panel_6, data=entwine)  # -> dataframe; inputs columns: list, data: tree; same code as py3_20

# ---- group: node classes / Create dataframe (from scratch) v001
py3_22 = Python3Script(columns="classes", data=round_2.Nearest)  # -> dataframe; inputs columns: list, data: tree; same code as py3_20

# ---- group: Inverse node network v002
py3_23 = Python3Script()  # -> inv_points, inv_lines; inputs lines: list of Line; same code as py3_19

# ---- group: kmeans clustering v002
# OTHER TOOLS
py3_24 = Python3Script()  # -> cluster_labels, clusters; inputs points: list
# ---------- py3_24: Python ----------
#! python3
#r: openpyxl, psycopg2, Ipython

import rhinoscriptsyntax as rs
import Rhino.Geometry as rg
from sklearn.cluster import KMeans
from Grasshopper import DataTree
from Grasshopper.Kernel.Data import GH_Path

# Ensure 'points' is a list of GUIDs representing points in Rhino/Grasshopper
# Convert num_clusters to an integer
num_clusters = int(num_clusters)
seed = int(seed)

# Step 1: Extract coordinates from GUIDs
point_coordinates = []
for guid in points:
    point = rs.coerce3dpoint(guid)
    if point:
        point_coordinates.append([point.X, point.Y, point.Z])

# Step 2: Perform KMeans clustering
kmeans = KMeans(n_clusters=num_clusters, random_state=seed, n_init="auto").fit(point_coordinates)
labels = kmeans.labels_

# Step 3: Organize points into a data tree based on cluster labels
clustered_points_tree = DataTree[object]()
for i in range(num_clusters):
    path = GH_Path(i)
    for idx, label in enumerate(labels):
        if label == i:
            clustered_points_tree.Add(points[idx], path)

# Create a list of cluster numbers for each index
point_clusters = [int(label) for label in labels]

# Output
clusters = clustered_points_tree
cluster_labels = point_clusters
# ---------- end py3_24 ----------

# ---- group: one-hot encode v001
py3_25 = Python3Script(cluster_labels=py3_24.cluster_labels)  # -> output; inputs cluster_labels: list
# ---------- py3_25: Python ----------
#! python3
#r: openpyxl, psycopg2, Ipython

import pandas as pd
from Grasshopper import DataTree
from Grasshopper.Kernel.Data import GH_Path

# Inputs:
# cluster_num: List of cluster indices where each index represents the cluster number

# Convert the list of cluster indices to a pandas DataFrame
df = pd.DataFrame({'cluster': cluster_labels})

# Perform one-hot encoding
one_hot = pd.get_dummies(df['cluster'])

# Initialize a new DataTree to hold the one-hot encoded results
one_hot_tree = DataTree[object]()

# Iterate over each cluster and add its one-hot encoded values to the DataTree
for i, column in enumerate(one_hot.columns):
    path = GH_Path(i)  # Create a new path for each cluster
    # Add the column values as a list to the corresponding path in the DataTree
    one_hot_tree.AddRange(one_hot[column].tolist(), path)

# Output the DataTree
output = one_hot_tree
# ---------- end py3_25 ----------

# ---- group: DBSCAN v002
py3_26 = Python3Script()  # -> cluster_labels, clusters; inputs points: list
# ---------- py3_26: Python ----------
#! python3
#r: openpyxl, psycopg2, Ipython

import rhinoscriptsyntax as rs
import Rhino.Geometry as rg
from sklearn.cluster import DBSCAN
from Grasshopper import DataTree
from Grasshopper.Kernel.Data import GH_Path

# Inputs: 
# points: List of point GUIDs
# eps: Maximum distance between two points for them to be considered in the same neighborhood
# min_samples: The minimum number of points required to form a dense region

# Step 1: Extract coordinates from GUIDs
point_coordinates = []
for guid in points:
    point = rs.coerce3dpoint(guid)
    if point:
        point_coordinates.append([point.X, point.Y, point.Z])

# Step 2: Convert min_samples to integer
min_samples = int(min_samples)

# Step 3: Perform DBSCAN clustering
dbscan = DBSCAN(eps=eps, min_samples=min_samples)
dbscan.fit(point_coordinates)
labels = dbscan.labels_

# Step 4: Replace outlier labels (-1) with 0
labels = [0 if label == -1 else label for label in labels]

# Step 5: Organize points into a data tree based on cluster labels
clustered_points_tree = DataTree[object]()
unique_labels = set(labels)

# Print unique labels for debugging
print("Unique labels:", unique_labels)

for label in unique_labels:
    # Create a path for each cluster label
    path = GH_Path(int(label))
    for idx, point_label in enumerate(labels):
        if point_label == label:
            clustered_points_tree.Add(points[idx], path)

# Create a list of clusters
point_clusters = labels

# Output
clusters = clustered_points_tree
cluster_num = point_clusters
# ---------- end py3_26 ----------

# ---- group: standard scaling (from df to df) v001
py3_27 = Python3Script(dataframe=py3_4)  # -> scaled_df
# ---------- py3_27: Python ----------
#! python3
#r: openpyxl, psycopg2, Ipython

import pandas as pd
import numpy as np
from sklearn.preprocessing import StandardScaler

# Assume 'dataframe' is a pandas DataFrame input with a single column

# Step 1: Extract the column name from the DataFrame
column = dataframe.columns[0]

# Step 2: Perform scaling using StandardScaler
sc = StandardScaler()
output = sc.fit_transform(dataframe[[column]])

# Step 3: Create a new DataFrame with the scaled data and the original column name
scaled_df = pd.DataFrame(output, columns=[column])
# ---------- end py3_27 ----------

# ---- group: standard scaling (from dataframe) v001
py3_28 = Python3Script(dataframe=py3_4)  # -> scaled
# ---------- py3_28: Python ----------
#! python3
#r: openpyxl, psycopg2, Ipython

import pandas as pd
import numpy as np
from sklearn.preprocessing import StandardScaler

# Assume 'dataframe' is a pandas DataFrame input
# and 'column' is the column name provided as a string

# Step 1: Perform scaling using StandardScaler
sc = StandardScaler()
output = sc.fit_transform(dataframe[[column]])

# Step 2: Convert the output to a list that Grasshopper can handle
# Convert the output (which is a NumPy array) to a Python list
scaled_list = output.flatten().tolist()

# Output: scaled_list can be connected to a panel or used in Grasshopper
scaled = scaled_list
# ---------- end py3_28 ----------

# ---- group: Assign range of values lo, mid, hi v001
py3_29 = Python3Script()  # -> low, medium, high
# ---------- py3_29: Python ----------
# Ensure num_list is a list, even if a single number is provided
if isinstance(num_list, int) or isinstance(num_list, float):
    num_list = [num_list]

# Initialize the output lists
below = []
in_between = []
above = []

# Iterate through the list and classify numbers
for num in num_list:
    if num < loVal:
        below.append(num)
    elif loVal <= num <= hiVal:
        in_between.append(num)
    else:
        above.append(num)

# # Assign to Grasshopper outputs
low = below
medium = in_between
high = above
# ---------- end py3_29 ----------

# ---- group: standard scaling (no df) v001
py3_30 = Python3Script()  # -> scaled; inputs data: tree
# ---------- py3_30: Python ----------
#! python3
#r: openpyxl, psycopg2, Ipython

import pandas as pd
import numpy as np
from sklearn.preprocessing import StandardScaler

##### CONVERT TO DATAFRAME
def tree_to_dataframe(columns, data_tree):
    # Ensure the number of branches matches the number of columns
    if len(columns) != len(data_tree.Branches):
        raise ValueError("The number of columns must match the number of branches in the data tree")
    
    # Convert each branch in the data tree to a column
    data_dict = {col: data_tree.Branches[i] for i, col in enumerate(columns)}
    
    # Create DataFrame
    df = pd.DataFrame(data_dict)
    return df

# Inputs
column_list = ["normalized_data"]  # List of column names
# column_list = columns  # List of column names
data_tree = data  # Data should be a tree joined with entwined

# Convert the data tree to a DataFrame
df = tree_to_dataframe(column_list, data_tree)
print(df)

# Output
# dataframe = df  # Output the DataFrame




##### NORMALIZE
# Assume 'dataframe' is a pandas DataFrame input
# and 'column' is the column name provided as a string

# Step 1: Perform scaling using StandardScaler
sc = StandardScaler()
output = sc.fit_transform(df[column_list])

# Step 2: Convert the output to a list that Grasshopper can handle
# Convert the output (which is a NumPy array) to a Python list
scaled_list = output.flatten().tolist()

# Output: scaled_list can be connected to a panel or used in Grasshopper
scaled = scaled_list
# ---------- end py3_30 ----------

# ---- group: Put together node dataframe WORKING
dom_3 = ConstructDomain(DomainStart=Slider(2000, range=2000..2024), DomainEnd=Slider(2024, range=2000..2024))
dom_4 = ConstructDomain(DomainStart=Slider(18, range=0..100), DomainEnd=Slider(60, range=0..100))
dom_5 = ConstructDomain(DomainStart=0, DomainEnd=Slider(12, range=0..100))
dom_6 = ConstructDomain(DomainStart=Slider(0, range=0..50), DomainEnd=Slider(50, range=0..50))
random_3 = Random(Range=dom_3, Number="46", Seed=2)
random_4 = Random(Range=dom_4, Number="46", Seed="46")
random_5 = Random(Range=dom_5, Number="46", Seed=2)
random_6 = Random(Range=dom_6, Number="46", Seed=2)
round_3 = Round(Number=random_3)  # -> Nearest, Floor, Ceiling
round_4 = Round(Number=random_4)  # -> Nearest, Floor, Ceiling
round_5 = Round(Number=random_5)  # -> Nearest, Floor, Ceiling
round_6 = Round(Number=random_6)  # -> Nearest, Floor, Ceiling

# ---- group: Put together node dataframe WORKING / standard scaling (NO dataframe) v001
py3_31 = Python3Script(data=round_4.Nearest)  # -> scaled; inputs data: tree
# ---------- py3_31: Python ----------
import pandas as pd
import numpy as np
from sklearn.preprocessing import StandardScaler

##### CONVERT TO DATAFRAME
def tree_to_dataframe(columns, data_tree):
    # Ensure the number of branches matches the number of columns
    if len(columns) != len(data_tree.Branches):
        raise ValueError("The number of columns must match the number of branches in the data tree")
    
    # Convert each branch in the data tree to a column
    data_dict = {col: data_tree.Branches[i] for i, col in enumerate(columns)}
    
    # Create DataFrame
    df = pd.DataFrame(data_dict)
    return df

# Inputs
column_list = ["normalized_data"]  # List of column names
# column_list = columns  # List of column names
data_tree = data  # Data should be a tree joined with entwined

# Convert the data tree to a DataFrame
df = tree_to_dataframe(column_list, data_tree)
print(df)

# Output
# dataframe = df  # Output the DataFrame




##### NORMALIZE
# Assume 'dataframe' is a pandas DataFrame input
# and 'column' is the column name provided as a string

# Step 1: Perform scaling using StandardScaler
sc = StandardScaler()
output = sc.fit_transform(df[column_list])

# Step 2: Convert the output to a list that Grasshopper can handle
# Convert the output (which is a NumPy array) to a Python list
scaled_list = output.flatten().tolist()

# Output: scaled_list can be connected to a panel or used in Grasshopper
scaled = scaled_list
# ---------- end py3_31 ----------

py3_32 = Python3Script(data=round_5.Nearest)  # -> scaled; inputs data: tree; same code as py3_31

py3_33 = Python3Script(data=round_3.Nearest)  # -> scaled; inputs data: tree; same code as py3_31

py3_34 = Python3Script(data=round_6.Nearest)  # -> scaled; inputs data: tree; same code as py3_31

# ---- group: Put together node dataframe WORKING (continued)
entwine_2 = Entwine(Branch0X=py3_32, Branch1X=py3_31, Branch2X=py3_34, Branch3X=py3_33, FlattenInputs=False)  # -> simplify(Result)

# ---- group: node features / Create dataframe (from scratch) v001
py3_35 = Python3Script(columns=merge, data=entwine_2)  # -> dataframe; inputs columns: list, data: tree; same code as py3_20

# ---- group: networkX graph from data v004a
# GRAPHS
py3_36 = Python3Script(
    points=py3_19.inv_points,
    lines=py3_19.inv_lines,
    n_features=py3_35,
    n_classes=py3_22,
    e_features=py3_21,
    e_classes=py3_20)  # -> G, G_nodes, G_edges; inputs points: list, lines: list
#   port lines: Complete network of line segments connected to one another.
#   port n_features: Dataframe should contain only data that will be processed.
#   port n_classes: Dataframe should contain only data that will be processed.
# ---------- py3_36: Python ----------
#! python3
#r: openpyxl, psycopg2, Ipython

import networkx as nx
import pandas as pd
import rhinoscriptsyntax as rs
import numpy as np

##### INPUTS ############################################################
nf_columns = n_features.columns
ef_columns = e_features.columns
nc_columns = n_classes.columns
ec_columns = e_classes.columns

################# ADD GEOMETRY (LINE SEGMENTS) AND CONVERT THEM TO DATAFRAMES IN A NETWORKX GRAPH ####################################
# Input: List of lines and original points (GUIDs)
network = [line for line in lines]  # Replace 'network' with your input parameter
original_point_guids = points

# Convert GUIDs to Point3d objects
original_points = [rs.coerce3dpoint(guid) for guid in original_point_guids]

# Create a mapping from points to node identifiers
point_to_node = { (pt.X, pt.Y, pt.Z): pt for pt in original_points }

# Create an empty graph
G = nx.Graph()

# Add edges to the graph
for line in network:
    start_point = rs.CurveStartPoint(line)
    end_point = rs.CurveEndPoint(line)

    start_point_tuple = (start_point.X, start_point.Y, start_point.Z)
    end_point_tuple = (end_point.X, end_point.Y, end_point.Z)
    
    if not G.has_node(start_point_tuple):
        G.add_node(start_point_tuple, pos=start_point_tuple)
    if not G.has_node(end_point_tuple):
        G.add_node(end_point_tuple, pos=end_point_tuple)
    
    G.add_edge(start_point_tuple, end_point_tuple)

# Create a DataFrame with nodes in the same order as original_points
node_positions = [(pt.X, pt.Y, pt.Z) for pt in original_points]
nodes_data = {pos: G.nodes[pos] for pos in node_positions if G.has_node(pos)}

# Convert nodes to DataFrame
nodes_df = pd.DataFrame(
    [(pos, nodes_data.get(pos, {})) for pos in node_positions],
    columns=['Nodes', 'Attributes']
)

# Extract x, y, z coordinates and add as separate columns
nodes_df['x'] = nodes_df['Attributes'].apply(lambda attr: attr['pos'][0])
nodes_df['y'] = nodes_df['Attributes'].apply(lambda attr: attr['pos'][1])
nodes_df['z'] = nodes_df['Attributes'].apply(lambda attr: attr['pos'][2])

# Save original order of nodes
nodes_df['df_order'] = nodes_df.index 

##Remove the original 'Attributes' column if no longer needed
nodes_df.drop(columns=['Attributes'], inplace=True)

# Convert edges to DataFrame
edges_df = pd.DataFrame(list(G.edges(data=True)), columns=['Source', 'Target', 'Attributes'])

# Add additional columns from other DataFrames (if applicable)
if 'nf_columns' in locals() and 'n_features' in locals():
    nodes_df[nf_columns] = n_features[nf_columns]
if 'ef_columns' in locals() and 'e_features' in locals():
    edges_df[ef_columns] = e_features[ef_columns]
if 'nc_columns' in locals() and 'n_classes' in locals():
    nodes_df["classes"] = n_classes[nc_columns]
if 'ec_columns' in locals() and 'e_classes' in locals():
    edges_df["classes"] = e_classes[ec_columns]

###################### ASSIGN ATTRIBUTES FOR GRAPH ###############################################################
# Inspect DataFrame columns and types
def inspect_dataframe(df):
    print("DataFrame inspection:")
    print(df.head())
    print(df.dtypes)
    for column in df.columns:
        if df[column].apply(lambda x: isinstance(x, (list, dict, np.ndarray))).any():
            print(f"Column '{column}' contains sequences or non-numeric data.")
    print("\n")

inspect_dataframe(nodes_df)
inspect_dataframe(edges_df)

# Convert DataFrame columns to float32
def convert_columns_to_float32(df, exclude_columns):
    for column in df.columns:
        if column not in exclude_columns:
            try:
                # Ensure column data is numeric
                df[column] = pd.to_numeric(df[column], errors='coerce')
                # Convert to float32
                df[column] = df[column].astype(np.float32)
            except Exception as e:
                print(f"Error converting column '{column}': {e}")
    return df

# Convert node and edge DataFrames to float32
nodes_df = convert_columns_to_float32(nodes_df, exclude_columns=['Nodes'])
edges_df = convert_columns_to_float32(edges_df, exclude_columns=['Source', 'Target'])

# Convert class columns to long integers
def convert_classes_to_long(df, class_columns):
    for column in class_columns:
        if column in df.columns:
            try:
                df[column] = df[column].astype(np.int64)
            except Exception as e:
                print(f"Error converting column '{column}': {e}")
    return df

# Convert classes to long integers
class_columns = ['classes']  # Add other class columns if needed
nodes_df = convert_classes_to_long(nodes_df, class_columns)
edges_df = convert_classes_to_long(edges_df, class_columns)

# Assign node attributes
for index, row in nodes_df.iterrows():
    node = row['Nodes']
    attributes = row.drop('Nodes').to_dict()
    G.nodes[node].update(attributes)

# Assign edge attributes
for index, row in edges_df.iterrows():
    source = row['Source']
    target = row['Target']
    attributes = row.drop(['Source', 'Target']).to_dict()
    G.edges[source, target].update(attributes)

# Print node and edge attributes to verify
print("Node attributes:")
for node in G.nodes:
    print(node, G.nodes[node])

print("\nEdge attributes:")
for edge in G.edges:
    print(edge, G.edges[edge])

##Remove the original 'Nodes' column if no longer needed
nodes_df.drop(columns=['Nodes'], inplace=True)

####################### OUTPUTS ######################################################################
# Output DataFrames
G_nodes = nodes_df
G_edges = edges_df
# Graph = G  # Uncomment if you need to output the graph itself

print(nodes_df.columns)
# ---------- end py3_36 ----------

# ---- group: networkX to DGL graph v003
networkx_to_dgl_graph = Python3Script(G=py3_36.G, G_nodes=py3_36.G_nodes, G_edges=py3_36.G_edges)  # -> dgl_graph, graph_nodes, graph_edges
#   port G_nodes: NetworkX nodes
#   port G_edges: NetworkX edges
# ---------- networkx_to_dgl_graph: Python ----------
#! python3
#r: openpyxl, psycopg2, Ipython

import dgl
import torch
import networkx as nx

# Assuming G is your NetworkX graph
# Ensure the graph is undirected before conversion
if G.is_directed():
    raise ValueError("NetworkX graph is directed. Please provide an undirected graph.")

print("Is the networkX graph directed?", G.is_directed())


# Manually add reverse edges for DGL
edges = list(G.edges())
reverse_edges = [(v, u) for u, v in edges]
G.add_edges_from(reverse_edges)

# Convert to DGL graph
nodes_attributes_list = G_nodes.columns.tolist()
graph = dgl.from_networkx(G, node_attrs=nodes_attributes_list)


# Additional processing for node attributes
columns_to_exclude = ['x', 'y', 'z', 'df_order', 'classes']
for i in nodes_attributes_list:
    graph.ndata[i] = torch.reshape(graph.ndata[i], (graph.ndata[i].shape[0], 1))

selected_attributes = [attr for attr in nodes_attributes_list if attr not in columns_to_exclude]
if len(selected_attributes) > 0:
    graph.ndata["feat"] = torch.cat([graph.ndata[i] for i in selected_attributes], 1)
    graph.ndata["feat"] = graph.ndata["feat"]
else:
    raise ValueError("No attributes selected for concatenation. Check your nodes_attributes_list slice.")

# Verify if the graph is now undirected
edges = graph.edges()
edge_set = set(zip(edges[0], edges[1]))
is_directed = len(edge_set) != graph.num_edges()

print("Is the DGL graph directed after conversion?", is_directed)


################## OUTPUTS
dgl_graph = graph
graph_nodes = (graph.nodes())
graph_edges = (graph.edges())
# ---------- end networkx_to_dgl_graph ----------

# ---- group: DATA TO NETWORKX TO DGL / networkX graph from data v004a
py3_37 = Python3Script(
    points=py3_19.inv_points,
    lines=py3_19.inv_lines,
    n_features=py3_35,
    n_classes=py3_22,
    e_features=py3_21,
    e_classes=py3_20)  # -> G, G_nodes, G_edges; inputs points: list, lines: list; same code as py3_36

# ---- group: DATA TO NETWORKX TO DGL / networkX to DGL graph v003
networkx_to_dgl_graph_2 = Python3Script(G=py3_37.G, G_nodes=py3_37.G_nodes, G_edges=py3_37.G_edges)  # -> dgl_graph, graph_nodes, graph_edges; same code as networkx_to_dgl_graph

# ---- group: GNN Transductive node classification v003
# GNN
py3_38 = Python3Script(graph=networkx_to_dgl_graph_2.dgl_graph)  # -> out, act_pred, pred_only, n_epochs, training_acc, validation_acc, predicted_label, true_label; inputs class_to_predict: Int32, neurons: Int32, learning_rate: Double, epochs: Int32, training: Boolean
#   port class_to_predict: Select the class to predict from your list of classes
#   port training: If false, training process is not performed
# ---------- py3_38: Python ----------
#! python3
#r: openpyxl, psycopg2, Ipython

import torch
import torch.nn as nn
import torch.nn.functional as F
from dgl.nn.pytorch import SAGEConv
from sklearn.model_selection import train_test_split
from collections import Counter


# import sys  # To use sys.exit()
# import numpy as np

# print(graph.ndata["classes"])



######### NEEDED TOOLS ############################################################
# Create a dict keyed by the dataframe original order and valued by the dgl index
reorder_dict = {}
# Iterate over the DataFrame's index and populate the dictionary
for i in range(len(graph.ndata['df_order'])):
    # Extract the value at index i
    key = graph.ndata['df_order'][i].item()  # Convert tensor to a scalar
    reorder_dict[key] = i
# print(reorder_dict)







######### PREPARE GRAPH FOR TRANSDUCTIVE CLASSIFICATION TASK #######################
# `graph` is a pre-existing DGL graph object with node data from another component
# and that `graph.ndata["classes"]` is a tensor containing the class labels for the nodes.


##Check classified nodes
# print(graph.ndata["classes"].size()) #Number of nodes
# print(graph.ndata["classes"]) #Classes for each node

##Check number of nodes for each class
# print(Counter([i[0] for i in graph.ndata["classes"].tolist()]))


# Get labeled and unlabeled nodes
labeled_nodes = [i.item() for i, j in zip(graph.nodes(), graph.ndata["classes"]) if j.item() != class_to_predict]
un_labeled_nodes = [i.item() for i, j in zip(graph.nodes(), graph.ndata["classes"]) if j.item() == class_to_predict]


# print(labeled_nodes)
# print(un_labeled_nodes)
print("labeled nodes: ", len(labeled_nodes))
print("unlabeled nodes: ", len(un_labeled_nodes))

## Separating between training and others
train_nodes, test_nodes = train_test_split(labeled_nodes, random_state=1, test_size=0.1) #Test
train_nodes, validation_nodes = train_test_split(train_nodes, random_state=1, test_size=0.11) #Validation

prediction_nodes = un_labeled_nodes ###PMASK
# print(len(train_nodes))
# print(len(test_nodes))
# print(len(validation_nodes))
# print(len(prediction_nodes))

## Create train/validation/test/prediction masks
# Each mask is just a boolean array of the same size of the number of nodes, positions of nodes to be included are set to True, and the rest is False
num_nodes = graph.number_of_nodes()
# print(num_nodes)



## METHOD 1 (ORIGINAL)
# Train mask
# print(sorted(train_nodes))
train_mask={i.item() :False for i in graph.nodes()}
# print(train_mask)
[train_mask.update({n:True}) for n in train_nodes]
# print(train_mask)

# Validation mask
# print(sorted(validation_nodes))
validation_mask={i.item() :False for i in graph.nodes()}
[validation_mask.update({n:True}) for n in validation_nodes]
# print(validation_mask)

# Test mask
# print(sorted(test_nodes))
test_mask={i.item() :False for i in graph.nodes()}
[test_mask.update({n:True}) for n in test_nodes]
# print(test_mask)

# Prediction mask
# print(sorted(prediction_nodes))
prediction_mask={i.item() :False for i in graph.nodes()} #########PMASK
[prediction_mask.update({n:True}) for n in prediction_nodes] #######PMASK
# print(prediction_mask)


## Assign mask to tensor
graph.ndata["train_mask"]=torch.tensor(list(train_mask.values()))
graph.ndata["validation_mask"]=torch.tensor(list(validation_mask.values()))
graph.ndata["test_mask"]=torch.tensor(list(test_mask.values()))
graph.ndata["prediction_mask"]=torch.tensor(list(prediction_mask.values())) #########PMASK




# ## METHOD 2
# # Initialize all masks tensors as False
# train_mask = torch.zeros(num_nodes, dtype=torch.bool)
# validation_mask = torch.zeros(num_nodes, dtype=torch.bool)
# test_mask = torch.zeros(num_nodes, dtype=torch.bool)
# prediction_mask = torch.zeros(num_nodes, dtype=torch.bool)
# # print(len(train_mask[train_nodes]))
# # print(train_mask[train_nodes])

# # Set the corresponding indices to True in each mask
# train_mask[train_nodes] = True
# validation_mask[validation_nodes] = True
# test_mask[test_nodes] = True
# prediction_mask[prediction_nodes] = True
# # print(len(prediction_mask[prediction_nodes]))

# #Assign masks to graph
# graph.ndata["train_mask"] = train_mask
# graph.ndata["validation_mask"] = validation_mask
# graph.ndata["test_mask"] = test_mask
# graph.ndata["prediction_mask"] = prediction_mask





# print(torch.tensor(list(train_mask.values())))

## Verify mask info such as length and actual data. Works for both methods
## Number of elements in each mask (should match number of nodes)
# print(len(train_mask))          # Should match num_nodes
# print(len(validation_mask))     # Should match num_nodes
# print(len(test_mask))           # Should match num_nodes
# print(len(prediction_mask))     # Should match num_nodes

## See all data within masks
# print(train_mask)          
# print(validation_mask)    
# print(test_mask)          
# print(prediction_mask)  

# print(graph)





######### LEARNING #######################
## Training of model based on unknown classes
## GNN module
class SAGE(nn.Module):
    def __init__(self, in_feats, hid_feats, out_feats):
        super().__init__()
        self.conv1 = SAGEConv(in_feats=in_feats, out_feats=hid_feats, aggregator_type='mean')
        self.conv2 = SAGEConv(in_feats=hid_feats, out_feats=out_feats, aggregator_type='mean')

    def forward(self, graph, inputs):
        h = self.conv1(graph, inputs)
        h = F.relu(h)
        h = self.conv2(graph, h)
        return h

## Get the features and label sizes
n_features = graph.ndata["feat"].shape[1]
classes_list = [t[0] for t in graph.ndata["classes"].tolist()]
n_labels = len(Counter(classes_list).keys())

# print(n_features)
# print(classes_list)
print("nLabels", n_labels)
# print(Counter(classes_list).keys())


## Hyperparameters 
n_hidden = neurons  # Example value, adjust as needed...default 4
lr = learning_rate     # Example value, adjust as needed...default 0.01
n_epochs = epochs # Example value, adjust as needed...default 70
device = torch.device('cuda' if torch.cuda.is_available() else 'cpu') # cpu or cuda. Current script looks for cuda first. Uses cpu if not available


# print(graph.ndata['feat'])


# Actual training
if training: #Looks for a button from the component called "training"
    
    model = SAGE(n_features, n_hidden, n_labels)
    optimizer = torch.optim.Adam(model.parameters(), lr=lr)
    model_path = "best_model"
    torch.manual_seed(40)
    best_val_acc = 0
    best_test_acc = 0

    features = graph.ndata['feat']
    labels = graph.ndata['classes']  
    train_mask_1 = graph.ndata['train_mask']
    val_mask_1 = graph.ndata['validation_mask']
    test_mask_1 = graph.ndata['test_mask']

    ## Test values
    # print(features)
    # print(labels)
    # print(train_mask_1)
    # print(val_mask_1)
    # print(test_mask_1)


    train_accs = []
    valid_accs = []


    for e in range(n_epochs):
        model.train() ## Test this
        optimizer.zero_grad() ## Test this

        # Forward pass
        logits = model(graph, features)

        # Compute predictions
        pred = logits.argmax(1)
        # print(pred)

        # Compute loss
        # loss = F.cross_entropy(logits_1d, labels_1d)
        loss = F.cross_entropy(logits[train_mask_1], labels[train_mask_1].squeeze())
        # loss = nn.CrossEntropyLoss()

        # Compute accuracy on training/validation/test
        train_acc = (pred[train_mask_1] == labels).float().mean()
        val_acc = (pred[val_mask_1] == labels).float().mean()
        test_acc = (pred[test_mask_1] == labels[test_mask_1]).float().mean()

        # Alternate method to compute aaccuracy yon training/validation/test
        # correct_train=0
        # for pr, gt in zip([i.item() for i in pred[train_mask_1]], [j.item() for j in labels[train_mask_1]]):
        #     if pr==gt:
        #         correct_train+=1
        # train_acc= correct_train/len(pred[train_mask_1])

        # correct_valid=0
        # for pr, gt in zip([i.item() for i in pred[val_mask_1]], [j.item() for j in labels[val_mask_1]]):
        #     if pr==gt:
        #         correct_valid+=1
        # val_acc= correct_valid/len(pred[val_mask_1])



        train_accs.append(train_acc)
        valid_accs.append(val_acc)
        # print(val_acc)

        # Save the best validation accuracy and the corresponding test accuracy.
        if best_val_acc < val_acc:
            best_val_acc = val_acc
            torch.save(model.state_dict(), model_path)

        # Backward pass
        optimizer.zero_grad()
        loss.backward()
        optimizer.step()


        # print(f'Epoch {e}, Loss: {loss.item():.3f}, Train Acc: {train_acc:.3f}, Val Acc: {val_acc:.3f}')

    # Load the best model
    # model.load_state_dict(torch.load(model_path)) ## Test this...hide if not used
# print(train_accs)
# print(valid_accs)




######### EVALUATION AND COMPLETING MISSING CLASSES #######################
# This section would involve using the trained model to predict labels for the nodes in `prediction_mask`.

## Test ground vs prediction (Check this for errors since unknown class is showing up!!!!!!!!)
#There should be no predictions of the unknown class since it is never seen in training
pred_values = [i.item() for i in pred] #Counts predictions across all data points (train, validation, and test).
print(Counter(pred_values))
# print(pred_values)

##Complete list of predicted values from pred_values reordered according to original dataframe
pred_values_reordered = [pred_values[reorder_dict[i]] for i in sorted(reorder_dict.keys())] # Reorder pred_values according to original dataframe to match nodes
# print(pred_values_reordered)

test_values = [i.item() for i in pred[test_mask_1]] #Counts predictions only for the test data points
print(Counter(test_values))
# print(test_values)



y_test = labels[test_mask_1]
predictions = pred[test_mask_1]
# print(y_test)
# print(predictions)
# print(pred[test_mask_1] )



## Generate values based on predicted and actual classes, using a custom logic that considers a prediction_mask.
classes_list=[t[0] for t in graph.ndata["classes"].tolist()]
classes_list_reordered=[classes_list[reorder_dict[i]] for i in sorted(reorder_dict.keys())]
# Initialize a list to store the assigned values

assigned_values = [] # List consists of a combo of actual values for what we know and newly predicted values
# Iterate over nodes and their corresponding predicted and actual classes
for i, (pred_value, actual_class) in enumerate(zip(pred_values_reordered, classes_list_reordered)):
    # Check if the prediction was correct
    if prediction_mask[reorder_dict[i]]:  # True if prediction is correct
        assigned_value = pred_value  # Assign the predicted class value
    else:  # False if prediction is incorrect
        assigned_value = actual_class  # Assign the actual class value
    
    # Append the assigned value to the list
    assigned_values.append(assigned_value)
# print(assigned_values


##OUTPUTS ##############################################################  

## Main predicted lists
pred_only = pred_values_reordered
act_pred = assigned_values




## For traning vs validation accuracy chart
training_acc = [t.item() for t in train_accs]
validation_acc = [t.item() for t in valid_accs]
# print (training_acc)
# print (validation_acc)




## For confusion matrix
## flatten to output
predicted_label = predictions.squeeze().tolist()
true_label = y_test.squeeze().tolist()

# print(predicted_label)
# print(true_label)

# print(labels)


## Complete missing classes
# print(Counter([t[0] for t in graph.ndata["classes"].tolist()]))

# print(graph.ndata["classes"].tolist())
# ---------- end py3_38 ----------

# ---- group: Training and Validation Accuracy v002
# PLOTTING
py3_39 = Python3Script(n_epochs=py3_38.n_epochs, training_acc=py3_38.training_acc, validation_acc=py3_38.validation_acc)  # -> max_train_acc, max_val_acc; inputs training_acc: list of Double, validation_acc: list of Double
# ---------- py3_39: Python ----------
#! python3
#r: openpyxl, psycopg2, Ipython

import matplotlib.pyplot as plt
import matplotlib

# Ensure you have the correct imports
import matplotlib.pyplot as plt

def plot_graph(n_epochs, train_accs, valid_accs, plot):
    if not plot:
        return  # If plot is False, exit the function

    # Clear the current figure to avoid plotting over previous plots
    plt.clf()
    plt.close()
    
    # Plot training and validation accuracy
    plt.plot(range(n_epochs), train_accs, label='Training Accuracy')
    plt.plot(range(n_epochs), valid_accs, label='Validation Accuracy')

    # Add title and labels
    plt.title('Training and Validation Accuracy')
    plt.xlabel('Epochs')
    plt.ylabel('Accuracy')

    # Display legend
    plt.legend(loc='best')

    # Display the plot
    plt.show()

# Call the plot function
# if plot:
plot_graph(n_epochs, training_acc, validation_acc, plot)


######### OUTPUTS ###########################################
max_train_acc = max(training_acc)
max_val_acc = max(validation_acc)
# ---------- end py3_39 ----------

# ---- group: Confusion matrix v004
py3_40 = Python3Script(predicted_label=py3_38.predicted_label, true_label=py3_38.true_label)  # -> accuracy_sc, precision_sc, recall_sc, f1_sc; inputs predicted_label: list, true_label: list
#   port accuracy_sc: Display Accuracy Score
#   port precision_sc: Display Precision Score
#   port recall_sc: Display Recall Score
#   port f1_sc: Display F1 Score
# ---------- py3_40: Python ----------
#! python3
#r: openpyxl, psycopg2, Ipython

import matplotlib.pyplot as plt
from sklearn.metrics import confusion_matrix, ConfusionMatrixDisplay, f1_score, precision_score, recall_score, accuracy_score
import numpy as np

# Define the plot function
def plot_graph(x, y):
    # Clear the figure to avoid duplicating plots
    plt.clf()
    plt.close()

    # Generate confusion matrix and plot
    cm = confusion_matrix(y, x, labels=np.unique(x))  # Ensure labels are set
    print(np.unique(true_label))
    disp = ConfusionMatrixDisplay(confusion_matrix=cm, display_labels=np.unique(x))
    disp.plot()

    # Display the plot
    plt.show()





# Check if the plot should be made and ensure it's done only once
if plot:
    plot_graph(predicted_label, true_label)
else:
    print("No valid data to plot.")

# Calculate metrics with proper handling for multi-class classification
accuracy_sc = accuracy_score(true_label, predicted_label)
precision_sc = precision_score(true_label, predicted_label, average='weighted')  # Use 'weighted' for multi-class
recall_sc = recall_score(true_label, predicted_label, average='weighted')        # Use 'weighted' for multi-class
f1_sc = f1_score(true_label, predicted_label, average='weighted')                # Use 'weighted' for multi-class

print("Accuracy:", accuracy_sc)
print("Precision:", precision_sc)
print("Recall:", recall_sc)
print("F1 Score:", f1_sc)
# ---------- end py3_40 ----------

# ---- group: DATA TO NETWORKX TO DGL
panel_7 = Panel(py3_37.G_nodes)
panel_8 = Panel(py3_37.G)
panel_9 = Panel(networkx_to_dgl_graph_2.dgl_graph)
panel_10 = Panel(networkx_to_dgl_graph_2.graph_nodes)
save = Button()
path = FilePath("H:\Shared drives\MaCAD_Thesis\08_plugin\parts\testingGraph.bin")

# ---- group: DATA TO NETWORKX TO DGL / Save DGL graph v001
py3_41 = Python3Script(graph=networkx_to_dgl_graph_2.dgl_graph, file_name=path, save=save)
#   port file_name: File name, and location in BIN format
# ---------- py3_41: Python ----------
#! python3
#r: openpyxl, psycopg2, Ipython

import dgl.data.utils as dgl_utils
import os

# Inputs
# file_name = file_name # String input in Grasshopper
save_trigger = save # Boolean input (True to save)

# Assuming 'graph' is the graph object created/available earlier in your script
# graph = ...  # Your graph generation logic here

if save_trigger:
    # Ensure the directory exists
    directory = os.path.dirname(file_name)
    if not os.path.exists(directory):
        os.makedirs(directory)

    # Save the graph
    dgl_utils.save_graphs(file_name, [graph])

    print("Graph saved to {file_name}")
# ---------- end py3_41 ----------

# ---- group: ONE-HOT ENCODING
number_slider = Slider(5, range=0..10)
pt = Point(py3_19.inv_points)
panel_11 = Panel("0")
series = Series(Start="1", Step=1, Count=number_slider)
concat = Concatenate(FragmentA="cluster", FragmentB=series, JoinSeparator="_")

# ---- group: ONE-HOT ENCODING / kmeans clustering v002
py3_42 = Python3Script(points=pt, num_clusters=number_slider, seed=panel_11)  # -> cluster_num, clusters; inputs points: list
# ---------- py3_42: Python ----------
#! python3
#r: openpyxl, psycopg2, Ipython

import rhinoscriptsyntax as rs
import Rhino.Geometry as rg
from sklearn.cluster import KMeans
from Grasshopper import DataTree
from Grasshopper.Kernel.Data import GH_Path

# Ensure 'points' is a list of GUIDs representing points in Rhino/Grasshopper
# Convert num_clusters to an integer
num_clusters = int(num_clusters)
seed = int(seed)

# Step 1: Extract coordinates from GUIDs
point_coordinates = []
for guid in points:
    point = rs.coerce3dpoint(guid)
    if point:
        point_coordinates.append([point.X, point.Y, point.Z])

# Step 2: Perform KMeans clustering
kmeans = KMeans(n_clusters=num_clusters, random_state=seed, n_init="auto").fit(point_coordinates)
labels = kmeans.labels_

# Step 3: Organize points into a data tree based on cluster labels
clustered_points_tree = DataTree[object]()
for i in range(num_clusters):
    path = GH_Path(i)
    for idx, label in enumerate(labels):
        if label == i:
            clustered_points_tree.Add(points[idx], path)

# Create a list of cluster numbers for each index
point_clusters = [int(label) for label in labels]

# Output
clusters = clustered_points_tree
cluster_num = point_clusters
# ---------- end py3_42 ----------

# ---- group: ONE-HOT ENCODING / one-hot encode v001
py3_43 = Python3Script(cluster_num=py3_42.cluster_num)  # -> output; inputs cluster_num: list
# ---------- py3_43: Python ----------
#! python3
#r: openpyxl, psycopg2, Ipython

import pandas as pd
from Grasshopper import DataTree
from Grasshopper.Kernel.Data import GH_Path

# Inputs:
# cluster_num: List of cluster indices where each index represents the cluster number

# Convert the list of cluster indices to a pandas DataFrame
df = pd.DataFrame({'cluster': cluster_num})

# Perform one-hot encoding
one_hot = pd.get_dummies(df['cluster'])

# Initialize a new DataTree to hold the one-hot encoded results
one_hot_tree = DataTree[object]()

# Iterate over each cluster and add its one-hot encoded values to the DataTree
for i, column in enumerate(one_hot.columns):
    path = GH_Path(i)  # Create a new path for each cluster
    # Add the column values as a list to the corresponding path in the DataTree
    one_hot_tree.AddRange(one_hot[column].tolist(), path)

# Output the DataTree
output = one_hot_tree
# ---------- end py3_43 ----------

# ---- group: ONE-HOT ENCODING (continued)
viewer = ParamViewer(py3_43)

# ----
path_2 = FilePath("H:\Shared drives\MaCAD_Thesis\08_plugin\parts\testingGraph.bin")
training = BooleanToggle(True)
plot = Button()

# ---- group: Load DGL graph v002
py3_44 = Python3Script(file_name=path_2, load=Toggle(True))  # -> out, graph; inputs load: Boolean
#   port file_name: Load DGL graph in BIN format
# ---------- py3_44: Python ----------
#! python3
#r: openpyxl, psycopg2, Ipython

import dgl.data.utils as dgl_utils
import os

# Inputs
file_name = file_name  # String input in Grasshopper for the file path
load_trigger = load  # Boolean input (True to load)

# Initialize the graph output
graph = None

if load_trigger:
    # Load the graph from the specified file
    graphs, _ = dgl_utils.load_graphs(file_name)
    if graphs:
        graph = graphs[0]
        print(f"Graph loaded from {file_name}")
    else:
        print(f"No graph found in {file_name}")

# print(graph.ndata)
# ---------- end py3_44 ----------

# ---- group: GNN Transductive node classification v003
py3_45 = Python3Script(
    graph=py3_44.graph,
    class_to_predict=Slider(0, range=0..2),
    hidden_layers=Slider(4, range=0..10),
    learning_rate=Slider(0.04, range=0..0.1),
    epochs=Slider(195, range=0..500),
    training=training)  # -> out, act_pred, pred_only, n_epochs, training_acc, validation_acc, predicted_label, true_label; inputs class_to_predict: Int32, hidden_layers: Int32, learning_rate: Double, epochs: Int32, training: Boolean
#   port class_to_predict: Select the class to predict from your list of classes
#   port training: If false, training process is not performed
# ---------- py3_45: Python ----------
#! python3
#r: openpyxl, psycopg2, Ipython

import torch
import torch.nn as nn
import torch.nn.functional as F
from dgl.nn.pytorch import SAGEConv
from sklearn.model_selection import train_test_split
from collections import Counter


# import sys  # To use sys.exit()
# import numpy as np

# print(graph.ndata["classes"])



######### NEEDED TOOLS ############################################################
# Create a dict keyed by the dataframe original order and valued by the dgl index
reorder_dict = {}
# Iterate over the DataFrame's index and populate the dictionary
for i in range(len(graph.ndata['df_order'])):
    # Extract the value at index i
    key = graph.ndata['df_order'][i].item()  # Convert tensor to a scalar
    reorder_dict[key] = i
# print(reorder_dict)







######### PREPARE GRAPH FOR TRANSDUCTIVE CLASSIFICATION TASK #######################
# `graph` is a pre-existing DGL graph object with node data from another component
# and that `graph.ndata["classes"]` is a tensor containing the class labels for the nodes.


##Check classified nodes
# print(graph.ndata["classes"].size()) #Number of nodes
# print(graph.ndata["classes"]) #Classes for each node

##Check number of nodes for each class
# print(Counter([i[0] for i in graph.ndata["classes"].tolist()]))


# Get labeled and unlabeled nodes
labeled_nodes = [i.item() for i, j in zip(graph.nodes(), graph.ndata["classes"]) if j.item() != class_to_predict]
un_labeled_nodes = [i.item() for i, j in zip(graph.nodes(), graph.ndata["classes"]) if j.item() == class_to_predict]


# print(labeled_nodes)
# print(un_labeled_nodes)
print("labeled nodes: ", len(labeled_nodes))
print("unlabeled nodes: ", len(un_labeled_nodes))

## Separating between training and others
train_nodes, test_nodes = train_test_split(labeled_nodes, random_state=1, test_size=0.1) #Test
train_nodes, validation_nodes = train_test_split(train_nodes, random_state=1, test_size=0.11) #Validation

prediction_nodes = un_labeled_nodes ###PMASK
# print(len(train_nodes))
# print(len(test_nodes))
# print(len(validation_nodes))
# print(len(prediction_nodes))

## Create train/validation/test/prediction masks
# Each mask is just a boolean array of the same size of the number of nodes, positions of nodes to be included are set to True, and the rest is False
num_nodes = graph.number_of_nodes()
# print(num_nodes)



## METHOD 1 (ORIGINAL)
# Train mask
# print(sorted(train_nodes))
train_mask={i.item() :False for i in graph.nodes()}
# print(train_mask)
[train_mask.update({n:True}) for n in train_nodes]
# print(train_mask)

# Validation mask
# print(sorted(validation_nodes))
validation_mask={i.item() :False for i in graph.nodes()}
[validation_mask.update({n:True}) for n in validation_nodes]
# print(validation_mask)

# Test mask
# print(sorted(test_nodes))
test_mask={i.item() :False for i in graph.nodes()}
[test_mask.update({n:True}) for n in test_nodes]
# print(test_mask)

# Prediction mask
# print(sorted(prediction_nodes))
prediction_mask={i.item() :False for i in graph.nodes()} #########PMASK
[prediction_mask.update({n:True}) for n in prediction_nodes] #######PMASK
# print(prediction_mask)


## Assign mask to tensor
graph.ndata["train_mask"]=torch.tensor(list(train_mask.values()))
graph.ndata["validation_mask"]=torch.tensor(list(validation_mask.values()))
graph.ndata["test_mask"]=torch.tensor(list(test_mask.values()))
graph.ndata["prediction_mask"]=torch.tensor(list(prediction_mask.values())) #########PMASK




# ## METHOD 2
# # Initialize all masks tensors as False
# train_mask = torch.zeros(num_nodes, dtype=torch.bool)
# validation_mask = torch.zeros(num_nodes, dtype=torch.bool)
# test_mask = torch.zeros(num_nodes, dtype=torch.bool)
# prediction_mask = torch.zeros(num_nodes, dtype=torch.bool)
# # print(len(train_mask[train_nodes]))
# # print(train_mask[train_nodes])

# # Set the corresponding indices to True in each mask
# train_mask[train_nodes] = True
# validation_mask[validation_nodes] = True
# test_mask[test_nodes] = True
# prediction_mask[prediction_nodes] = True
# # print(len(prediction_mask[prediction_nodes]))

# #Assign masks to graph
# graph.ndata["train_mask"] = train_mask
# graph.ndata["validation_mask"] = validation_mask
# graph.ndata["test_mask"] = test_mask
# graph.ndata["prediction_mask"] = prediction_mask





# print(torch.tensor(list(train_mask.values())))

## Verify mask info such as length and actual data. Works for both methods
## Number of elements in each mask (should match number of nodes)
# print(len(train_mask))          # Should match num_nodes
# print(len(validation_mask))     # Should match num_nodes
# print(len(test_mask))           # Should match num_nodes
# print(len(prediction_mask))     # Should match num_nodes

## See all data within masks
# print(train_mask)          
# print(validation_mask)    
# print(test_mask)          
# print(prediction_mask)  

# print(graph)





######### LEARNING #######################
## Training of model based on unknown classes
## GNN module
class SAGE(nn.Module):
    def __init__(self, in_feats, hid_feats, out_feats):
        super().__init__()
        self.conv1 = SAGEConv(in_feats=in_feats, out_feats=hid_feats, aggregator_type='mean')
        self.conv2 = SAGEConv(in_feats=hid_feats, out_feats=out_feats, aggregator_type='mean')

    def forward(self, graph, inputs):
        h = self.conv1(graph, inputs)
        h = F.relu(h)
        h = self.conv2(graph, h)
        return h

## Get the features and label sizes
n_features = graph.ndata["feat"].shape[1]
classes_list = [t[0] for t in graph.ndata["classes"].tolist()]
n_labels = len(Counter(classes_list).keys())

# print(n_features)
# print(classes_list)
print("nLabels", n_labels)
# print(Counter(classes_list).keys())


## Hyperparameters 
n_hidden = hidden_layers  # Example value, adjust as needed...default 4
lr = learning_rate     # Example value, adjust as needed...default 0.01
n_epochs = epochs # Example value, adjust as needed...default 70
device = torch.device('cuda' if torch.cuda.is_available() else 'cpu') # cpu or cuda. Current script looks for cuda first. Uses cpu if not available


# print(graph.ndata['feat'])


# Actual training
if training: #Looks for a button from the component called "training"
    
    model = SAGE(n_features, n_hidden, n_labels)
    optimizer = torch.optim.Adam(model.parameters(), lr=lr)
    model_path = "best_model"
    torch.manual_seed(40)
    best_val_acc = 0
    best_test_acc = 0

    features = graph.ndata['feat']
    labels = graph.ndata['classes']  
    train_mask_1 = graph.ndata['train_mask']
    val_mask_1 = graph.ndata['validation_mask']
    test_mask_1 = graph.ndata['test_mask']

    ## Test values
    # print(features)
    # print(labels)
    # print(train_mask_1)
    # print(val_mask_1)
    # print(test_mask_1)


    train_accs = []
    valid_accs = []


    for e in range(n_epochs):
        model.train() ## Test this
        optimizer.zero_grad() ## Test this

        # Forward pass
        logits = model(graph, features)

        # Compute predictions
        pred = logits.argmax(1)
        # print(pred)

        # Compute loss
        # loss = F.cross_entropy(logits_1d, labels_1d)
        loss = F.cross_entropy(logits[train_mask_1], labels[train_mask_1].squeeze())
         

        # Compute accuracy on training/validation/test
        train_acc = (pred[train_mask_1] == labels).float().mean()
        val_acc = (pred[val_mask_1] == labels).float().mean()
        test_acc = (pred[test_mask_1] == labels[test_mask_1]).float().mean()

        # Alternate method to compute aaccuracy yon training/validation/test
        # correct_train=0
        # for pr, gt in zip([i.item() for i in pred[train_mask_1]], [j.item() for j in labels[train_mask_1]]):
        #     if pr==gt:
        #         correct_train+=1
        # train_acc= correct_train/len(pred[train_mask_1])

        # correct_valid=0
        # for pr, gt in zip([i.item() for i in pred[val_mask_1]], [j.item() for j in labels[val_mask_1]]):
        #     if pr==gt:
        #         correct_valid+=1
        # val_acc= correct_valid/len(pred[val_mask_1])



        train_accs.append(train_acc)
        valid_accs.append(val_acc)
        # print(val_acc)

        # Save the best validation accuracy and the corresponding test accuracy.
        if best_val_acc < val_acc:
            best_val_acc = val_acc
            torch.save(model.state_dict(), model_path)

        # Backward pass
        optimizer.zero_grad()
        loss.backward()
        optimizer.step()


        print(f'Epoch {e}, Loss: {loss.item():.3f}, Train Acc: {train_acc:.3f}, Val Acc: {val_acc:.3f}')

    # Load the best model
    # model.load_state_dict(torch.load(model_path)) ## Test this...hide if not used

# print(train_accs)
# print(valid_accs)




######### EVALUATION AND COMPLETING MISSING CLASSES #######################
# This section would involve using the trained model to predict labels for the nodes in `prediction_mask`.

## Test ground vs prediction (Check this for errors since unknown class is showing up!!!!!!!!)
#There should be no predictions of the unknown class since it is never seen in training
pred_values = [i.item() for i in pred] #Counts predictions across all data points (train, validation, and test).
print(Counter(pred_values))
# print(pred_values)

##Complete list of predicted values from pred_values reordered according to original dataframe
pred_values_reordered = [pred_values[reorder_dict[i]] for i in sorted(reorder_dict.keys())] # Reorder pred_values according to original dataframe to match nodes
# print(pred_values_reordered)

test_values = [i.item() for i in pred[test_mask_1]] #Counts predictions only for the test data points
print(Counter(test_values))
# print(test_values)



y_test = labels[test_mask_1]
predictions = pred[test_mask_1]
# print(y_test)
# print(predictions)
# print(pred[test_mask_1] )



## Generate values based on predicted and actual classes, using a custom logic that considers a prediction_mask.
classes_list=[t[0] for t in graph.ndata["classes"].tolist()]
classes_list_reordered=[classes_list[reorder_dict[i]] for i in sorted(reorder_dict.keys())]
# Initialize a list to store the assigned values

assigned_values = [] # List consists of a combo of actual values for what we know and newly predicted values
# Iterate over nodes and their corresponding predicted and actual classes
for i, (pred_value, actual_class) in enumerate(zip(pred_values_reordered, classes_list_reordered)):
    # Check if the prediction was correct
    if prediction_mask[reorder_dict[i]]:  # True if prediction is correct
        assigned_value = pred_value  # Assign the predicted class value
    else:  # False if prediction is incorrect
        assigned_value = actual_class  # Assign the actual class value
    
    # Append the assigned value to the list
    assigned_values.append(assigned_value)
# print(assigned_values


##OUTPUTS ##############################################################  

## Main predicted lists
pred_only = pred_values_reordered
act_pred = assigned_values




## For traning vs validation accuracy chart
training_acc = [t.item() for t in train_accs]
validation_acc = [t.item() for t in valid_accs]
# print (training_acc)
# print (validation_acc)




## For confusion matrix
## flatten to output
predicted_label = predictions.squeeze().tolist()
true_label = y_test.squeeze().tolist()

# print(predicted_label)
# print(true_label)

# print(labels)


## Complete missing classes
# print(Counter([t[0] for t in graph.ndata["classes"].tolist()]))

# print(graph.ndata["classes"].tolist())
# ---------- end py3_45 ----------

# ---- group: Confusion matrix v004
py3_46 = Python3Script(predicted_label=py3_45.predicted_label, true_label=py3_45.true_label, plot=Button())  # -> accuracy_sc, precision_sc, recall_sc, f1_sc; inputs predicted_label: list, true_label: list; same code as py3_40

# ---- group: Training and Validation Accuracy v002
py3_47 = Python3Script(n_epochs=py3_45.n_epochs, training_acc=py3_45.training_acc, validation_acc=py3_45.validation_acc, plot=plot)  # -> max_train_acc, max_val_acc; inputs training_acc: list of Double, validation_acc: list of Double; same code as py3_39

# ----
panel_12 = Panel(py3_44.out)
panel_13 = Panel(py3_44.graph)
panel_14 = Panel(py3_45.out)
predictions = Panel(py3_45.act_pred)
panel_15 = Panel([py3_47.max_train_acc, py3_47.max_val_acc])
model_scores = Panel([py3_46.accuracy_sc, py3_46.precision_sc, py3_46.recall_sc, py3_46.f1_sc])
